% Simulink data dictionary PdiExperiment.sldd

pdiVsKd = Simulink.Parameter(0.01, StorageClass="ExportedGlobal", Alias="pdiVsKd", DataType="double")
pdiVsKi = Simulink.Parameter(0.1, StorageClass="ExportedGlobal", Alias="pdiVsKi", DataType="double")
pdiVsKp = Simulink.Parameter(1, StorageClass="ExportedGlobal", Alias="pdiVsKp", DataType="double")
pdiVsFeedforward = Simulink.Parameter(1, StorageClass="ExportedGlobal", Alias="pdiVsFeedforward", DataType="double")
DefaultConfiguration = Simulink.ConfigSet(StartTime="0", StopTime="10", FixedStep="0.01", Solver="FixedStepDiscrete", ProdHWDeviceType="Intel->x86-64 (Windows64)", SystemTargetFile="ert.tlc", TargetLang="C")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

pdi = Simulink.Signal(StorageClass="ExportedGlobal", Alias="gPdiData", DataType="Bus: pdiBus", InitialValue="[ 10 1 0.1 0.0]")  % This is an instance of the pdiBus that is set up as exported global so that presumeably
  % we could modify it's values from C code.

pidControlParamBus = Simulink.Bus(DataScope="Exported", HeaderFile="pidDataBus.h")  % An Example of a bus to contain PDI data that could be used throughout a model.
  feedforward: double
  kp: double
  ki: double
  kd: double

pdiBus = Simulink.Bus(DataScope="Exported", HeaderFile="pdiBus.h")
  version: uint32
  status: uint32
  controllerCount: int32
  verticalSpeed: Bus: pidControlParamBus
  altitude: Bus: pidControlParamBus
  pathFollower: Bus: pidControlParamBus
  pitchControl: Bus: pidControlParamBus

pdiBusMatLabStruct = struct(
  version=uint32(0),
  status=uint32(0),
  controllerCount=int32(0),
  verticalSpeed=struct(feedforward=0, kp=0, ki=0, kd=0),
  altitude=struct(feedforward=0, kp=0, ki=0, kd=0),
  pathFollower=struct(feedforward=0, kp=0, ki=0, kd=0),
  pitchControl=struct(feedforward=0, kp=0, ki=0, kd=0))

pdiParams = Simulink.Parameter(struct(
  version=uint32(0),
  status=uint32(0),
  controllerCount=int32(0),
  verticalSpeed=struct(feedforward=0, kp=0, ki=0, kd=0),
  altitude=struct(feedforward=0, kp=0, ki=0, kd=0),
  pathFollower=struct(feedforward=0, kp=0, ki=0, kd=0),
  pitchControl=struct(feedforward=0, kp=0, ki=0, kd=0)), StorageClass="ExportedGlobal", Alias="gPdiParams", DataType="Bus: pdiBus")